# Grasshopper definition Parametric deformation of shoe last v3.gh (Grasshopper 1.0.7)
# plug-ins: Kangaroo2 Components

# ----
# Ball circumf. measurement input
ball = Slider(245, range=0..1000)

# ----
# Inputs
# Toe circumf. measurement input
toe_box = Slider(220, range=0..1000)

# ----
# Ankle circumf. measurement input
ankle = Slider(247, range=0..1000)

# ----
# Waist circumf. measurement input
waist = Slider(248, range=0..1000)

# ----
# Instep circumf. measurement input
instep = Slider(295, range=0..1000)

# ----
# Sole circumf. measurement input
sole = Slider(615, range=0..1000)

# ----
# Inputs
# Ball circumf. measurement input
ball_2 = Slider(245, range=0..1000)

# ----
# Base shoe last model
brep = Brep(<brep referenced from the Rhino model>)
triangulate = Triangulate(Mesh=brep)  # -> Mesh, Count

# ----
# Ankle circumf. measurement input
ankle_2 = Slider(247, range=0..1000)

# ----
# Waist circumf. measurement input
waist_2 = Slider(248, range=0..1000)

# ----
# Instep circumf. measurement input
instep_2 = Slider(295, range=0..1000)

# ----
# Sole circumf. measurement input
sole_2 = Slider(615, range=0..1000)

# ----
# Base shoe last model
brep_2 = Brep(<brep referenced from the Rhino model>)
triangulate_2 = Triangulate(Mesh=brep_2)  # -> Mesh, Count

# ----
# Inputs
# Ball circumf. measurement input
ball_3 = Slider(245, range=0..1000)

# ----
# Waist circumf. measurement input
waist_3 = Slider(248, range=0..1000)

# ----
# Ankle circumf. measurement input
ankle_3 = Slider(247, range=0..1000)

# ----
# Instep circumf. measurement input
instep_3 = Slider(295, range=0..1000)

# ----
# Sole circumf. measurement input
sole_3 = Slider(615, range=0..1000)

# ----
# Base shoe last model
brep_3 = Brep(<brep referenced from the Rhino model>)
triangulate_3 = Triangulate(Mesh=brep_3)  # -> Mesh, Count

# ----
# Sole
# control curve
curve = Curve(<curve referenced from the Rhino model>)
surface = Surface(<surface referenced from the Rhino model>)
length = Length(Curve=curve)
panel = Panel(length)
control_points = ControlPoints(Curve=curve)  # -> Points, Weights, Knots
mesh_closest_point = MeshClosestPoint(Point=control_points.Points, Mesh=triangulate.Mesh)  # -> Point, Index, Parameter
division = Division(A=length, B=sole)
area = Area(Geometry=surface)  # -> Area, Centroid
division_2 = Division(A=1, B=division)
mesh_eval = MeshEval(Mesh=triangulate.Mesh, Parameter=mesh_closest_point.Parameter)  # -> Point, Normal, Colour
scale = Scale(Geometry=curve, Center=area.Centroid, Factor=division_2)  # -> Geometry, Transform
control_points_2 = ControlPoints(Curve=scale.Geometry)  # -> Points, Weights, Knots
vector_2pt = Vector2Pt(PointA=mesh_closest_point.Point, PointB=control_points_2.Points, Unitize=False)  # -> Vector, Length
spatial_deform_custom = SpatialDeformCustom(Geometry=triangulate.Mesh, Syntax=mesh_eval.Point, Forces=vector_2pt.Vector, Falloff="1/x^3")  # disabled
colour_picker = ColourPicker(PickedColour=RGB(115, 125, 60))
vector_display_ex = VectorDisplayEx(Point=mesh_closest_point.Point, Vector=vector_2pt.Vector, Colour=colour_picker, Width=Slider(3, range=0..100))

# ----
# Ankle control curve
curve_2 = Curve(<curve referenced from the Rhino model>)
length_2 = Length(Curve=curve_2)
panel_2 = Panel(length_2)
control_points_3 = ControlPoints(Curve=curve_2)  # -> Points, Weights, Knots
mesh_closest_point_2 = MeshClosestPoint(Point=control_points_3.Points, Mesh=triangulate.Mesh)  # -> Point, Index, Parameter
division_3 = Division(A=length_2, B=ankle)
area_2 = Area(Geometry=curve_2)  # -> Area, Centroid
division_4 = Division(A=1, B=division_3)
mesh_eval_2 = MeshEval(Mesh=triangulate.Mesh, Parameter=mesh_closest_point_2.Parameter)  # -> Point, Normal, Colour
scale_2 = Scale(Geometry=curve_2, Center=area_2.Centroid, Factor=division_4)  # -> Geometry, Transform
control_points_4 = ControlPoints(Curve=scale_2.Geometry)  # -> Points, Weights, Knots
vector_2pt_2 = Vector2Pt(PointA=mesh_closest_point_2.Point, PointB=control_points_4.Points, Unitize=False)  # -> Vector, Length
spatial_deform_custom_2 = SpatialDeformCustom(Geometry=triangulate.Mesh, Syntax=mesh_eval_2.Point, Forces=vector_2pt_2.Vector, Falloff="1/x^3")  # disabled
colour_picker_2 = ColourPicker(PickedColour=RGB(187, 209, 63))
vector_display_ex_2 = VectorDisplayEx(Point=mesh_closest_point_2.Point, Vector=vector_2pt_2.Vector, Colour=colour_picker_2, Width=Slider(3, range=0..100))

curve_3 = Curve(<curve referenced from the Rhino model>)
surface_2 = Surface(<surface referenced from the Rhino model>)
length_3 = Length(Curve=curve_3)
panel_3 = Panel(length_3)
control_points_5 = ControlPoints(Curve=curve_3)  # -> Points, Weights, Knots
mesh_closest_point_3 = MeshClosestPoint(Point=control_points_5.Points, Mesh=triangulate_2.Mesh)  # -> Point, Index, Parameter
division_5 = Division(A=length_3, B=sole_2)
area_3 = Area(Geometry=surface_2)  # -> Area, Centroid
division_6 = Division(A=1, B=division_5)
mesh_eval_3 = MeshEval(Mesh=triangulate_2.Mesh, Parameter=mesh_closest_point_3.Parameter)  # -> Point, Normal, Colour
scale_3 = Scale(Geometry=curve_3, Center=area_3.Centroid, Factor=division_6)  # -> Geometry, Transform
control_points_6 = ControlPoints(Curve=scale_3.Geometry)  # -> Points, Weights, Knots
vector_2pt_3 = Vector2Pt(PointA=mesh_closest_point_3.Point, PointB=control_points_6.Points, Unitize=False)  # -> Vector, Length
spatial_deform_custom_3 = SpatialDeformCustom(Geometry=triangulate_2.Mesh, Syntax=mesh_eval_3.Point, Forces=vector_2pt_3.Vector, Falloff="1/x^3")  # disabled
colour_picker_3 = ColourPicker(PickedColour=RGB(115, 125, 60))
vector_display_ex_3 = VectorDisplayEx(Point=mesh_closest_point_3.Point, Vector=vector_2pt_3.Vector, Colour=colour_picker_3, Width=Slider(3, range=0..100))

# ----
# Instep control curve
curve_4 = Curve(<curve referenced from the Rhino model>)
length_4 = Length(Curve=curve_4)
panel_4 = Panel(length_4)
control_points_7 = ControlPoints(Curve=curve_4)  # -> Points, Weights, Knots
mesh_closest_point_4 = MeshClosestPoint(Point=control_points_7.Points, Mesh=triangulate.Mesh)  # -> Point, Index, Parameter
division_7 = Division(A=length_4, B=instep)
area_4 = Area(Geometry=curve_4)  # -> Area, Centroid
division_8 = Division(A=1, B=division_7)
mesh_eval_4 = MeshEval(Mesh=triangulate.Mesh, Parameter=mesh_closest_point_4.Parameter)  # -> Point, Normal, Colour
scale_4 = Scale(Geometry=curve_4, Center=area_4.Centroid, Factor=division_8)  # -> Geometry, Transform
control_points_8 = ControlPoints(Curve=scale_4.Geometry)  # -> Points, Weights, Knots
vector_2pt_4 = Vector2Pt(PointA=mesh_closest_point_4.Point, PointB=control_points_8.Points, Unitize=False)  # -> Vector, Length
spatial_deform_custom_4 = SpatialDeformCustom(Geometry=triangulate.Mesh, Syntax=mesh_eval_4.Point, Forces=vector_2pt_4.Vector, Falloff="1/x^3")  # disabled
colour_picker_4 = ColourPicker(PickedColour=RGB(193, 209, 102))
vector_display_ex_4 = VectorDisplayEx(Point=mesh_closest_point_4.Point, Vector=vector_2pt_4.Vector, Colour=colour_picker_4, Width=Slider(3, range=0..100))

# ----
# Ankle control curve
curve_5 = Curve(<curve referenced from the Rhino model>)
length_5 = Length(Curve=curve_5)
panel_5 = Panel(length_5)
control_points_9 = ControlPoints(Curve=curve_5)  # -> Points, Weights, Knots
mesh_closest_point_5 = MeshClosestPoint(Point=control_points_9.Points, Mesh=triangulate_2.Mesh)  # -> Point, Index, Parameter
division_9 = Division(A=length_5, B=ankle_2)
area_5 = Area(Geometry=curve_5)  # -> Area, Centroid
division_10 = Division(A=1, B=division_9)
mesh_eval_5 = MeshEval(Mesh=triangulate_2.Mesh, Parameter=mesh_closest_point_5.Parameter)  # -> Point, Normal, Colour
scale_5 = Scale(Geometry=curve_5, Center=area_5.Centroid, Factor=division_10)  # -> Geometry, Transform
control_points_10 = ControlPoints(Curve=scale_5.Geometry)  # -> Points, Weights, Knots
vector_2pt_5 = Vector2Pt(PointA=mesh_closest_point_5.Point, PointB=control_points_10.Points, Unitize=False)  # -> Vector, Length
spatial_deform_custom_5 = SpatialDeformCustom(Geometry=triangulate_2.Mesh, Syntax=mesh_eval_5.Point, Forces=vector_2pt_5.Vector, Falloff="1/x^3")  # disabled
colour_picker_5 = ColourPicker(PickedColour=RGB(187, 209, 63))
vector_display_ex_5 = VectorDisplayEx(Point=mesh_closest_point_5.Point, Vector=vector_2pt_5.Vector, Colour=colour_picker_5, Width=Slider(3, range=0..100))

# ----
# Waist control curve
curve_6 = Curve(<curve referenced from the Rhino model>)
length_6 = Length(Curve=curve_6)
panel_6 = Panel(length_6)
control_points_11 = ControlPoints(Curve=curve_6)  # -> Points, Weights, Knots
mesh_closest_point_6 = MeshClosestPoint(Point=control_points_11.Points, Mesh=triangulate.Mesh)  # -> Point, Index, Parameter
division_11 = Division(A=length_6, B=waist)
area_6 = Area(Geometry=curve_6)  # -> Area, Centroid
division_12 = Division(A=1, B=division_11)
mesh_eval_6 = MeshEval(Mesh=triangulate.Mesh, Parameter=mesh_closest_point_6.Parameter)  # -> Point, Normal, Colour
scale_6 = Scale(Geometry=curve_6, Center=area_6.Centroid, Factor=division_12)  # -> Geometry, Transform
control_points_12 = ControlPoints(Curve=scale_6.Geometry)  # -> Points, Weights, Knots
vector_2pt_6 = Vector2Pt(PointA=mesh_closest_point_6.Point, PointB=control_points_12.Points, Unitize=False)  # -> Vector, Length
spatial_deform_custom_6 = SpatialDeformCustom(Geometry=triangulate.Mesh, Syntax=mesh_eval_6.Point, Forces=vector_2pt_6.Vector, Falloff="1/x^3")  # disabled
colour_picker_6 = ColourPicker(PickedColour=RGB(56, 59, 39))
vector_display_ex_6 = VectorDisplayEx(Point=mesh_closest_point_6.Point, Vector=vector_2pt_6.Vector, Colour=colour_picker_6, Width=Slider(3, range=0..100))

# ----
# Instep control curve
curve_7 = Curve(<curve referenced from the Rhino model>)
length_7 = Length(Curve=curve_7)
panel_7 = Panel(length_7)
control_points_13 = ControlPoints(Curve=curve_7)  # -> Points, Weights, Knots
mesh_closest_point_7 = MeshClosestPoint(Point=control_points_13.Points, Mesh=triangulate_2.Mesh)  # -> Point, Index, Parameter
division_13 = Division(A=length_7, B=instep_2)
area_7 = Area(Geometry=curve_7)  # -> Area, Centroid
division_14 = Division(A=1, B=division_13)
mesh_eval_7 = MeshEval(Mesh=triangulate_2.Mesh, Parameter=mesh_closest_point_7.Parameter)  # -> Point, Normal, Colour
scale_7 = Scale(Geometry=curve_7, Center=area_7.Centroid, Factor=division_14)  # -> Geometry, Transform
control_points_14 = ControlPoints(Curve=scale_7.Geometry)  # -> Points, Weights, Knots
vector_2pt_7 = Vector2Pt(PointA=mesh_closest_point_7.Point, PointB=control_points_14.Points, Unitize=False)  # -> Vector, Length
spatial_deform_custom_7 = SpatialDeformCustom(Geometry=triangulate_2.Mesh, Syntax=mesh_eval_7.Point, Forces=vector_2pt_7.Vector, Falloff="1/x^3")  # disabled
colour_picker_7 = ColourPicker(PickedColour=RGB(193, 209, 102))
vector_display_ex_7 = VectorDisplayEx(Point=mesh_closest_point_7.Point, Vector=vector_2pt_7.Vector, Colour=colour_picker_7, Width=Slider(3, range=0..100))

# ----
# Ball control curve
surface_3 = Surface(<surface referenced from the Rhino model>)
curve_8 = Curve(<curve referenced from the Rhino model>)
length_8 = Length(Curve=curve_8)
panel_8 = Panel(length_8)
control_points_15 = ControlPoints(Curve=curve_8)  # -> Points, Weights, Knots
mesh_closest_point_8 = MeshClosestPoint(Point=control_points_15.Points, Mesh=triangulate.Mesh)  # -> Point, Index, Parameter
division_15 = Division(A=length_8, B=ball)
area_8 = Area(Geometry=surface_3)  # -> Area, Centroid
division_16 = Division(A=1, B=division_15)
mesh_eval_8 = MeshEval(Mesh=triangulate.Mesh, Parameter=mesh_closest_point_8.Parameter)  # -> Point, Normal, Colour
scale_8 = Scale(Geometry=curve_8, Center=area_8.Centroid, Factor=division_16)  # -> Geometry, Transform
control_points_16 = ControlPoints(Curve=scale_8.Geometry)  # -> Points, Weights, Knots
vector_2pt_8 = Vector2Pt(PointA=mesh_closest_point_8.Point, PointB=control_points_16.Points, Unitize=False)  # -> Vector, Length
spatial_deform_custom_8 = SpatialDeformCustom(Geometry=triangulate.Mesh, Syntax=mesh_eval_8.Point, Forces=vector_2pt_8.Vector, Falloff="1/x^3")  # disabled
colour_picker_8 = ColourPicker(PickedColour=RGB(187, 209, 63))
vector_display_ex_8 = VectorDisplayEx(Point=mesh_closest_point_8.Point, Vector=vector_2pt_8.Vector, Colour=colour_picker_8, Width=Slider(3, range=0..100))

# ----
# Waist control curve
curve_9 = Curve(<curve referenced from the Rhino model>)
length_9 = Length(Curve=curve_9)
panel_9 = Panel(length_9)
control_points_17 = ControlPoints(Curve=curve_9)  # -> Points, Weights, Knots
mesh_closest_point_9 = MeshClosestPoint(Point=control_points_17.Points, Mesh=triangulate_2.Mesh)  # -> Point, Index, Parameter
division_17 = Division(A=length_9, B=waist_2)
area_9 = Area(Geometry=curve_9)  # -> Area, Centroid
division_18 = Division(A=1, B=division_17)
mesh_eval_9 = MeshEval(Mesh=triangulate_2.Mesh, Parameter=mesh_closest_point_9.Parameter)  # -> Point, Normal, Colour
scale_9 = Scale(Geometry=curve_9, Center=area_9.Centroid, Factor=division_18)  # -> Geometry, Transform
control_points_18 = ControlPoints(Curve=scale_9.Geometry)  # -> Points, Weights, Knots
vector_2pt_9 = Vector2Pt(PointA=mesh_closest_point_9.Point, PointB=control_points_18.Points, Unitize=False)  # -> Vector, Length
spatial_deform_custom_9 = SpatialDeformCustom(Geometry=triangulate_2.Mesh, Syntax=mesh_eval_9.Point, Forces=vector_2pt_9.Vector, Falloff="1/x^3")  # disabled
colour_picker_9 = ColourPicker(PickedColour=RGB(56, 59, 39))
vector_display_ex_9 = VectorDisplayEx(Point=mesh_closest_point_9.Point, Vector=vector_2pt_9.Vector, Colour=colour_picker_9, Width=Slider(3, range=0..100))

# ----
# Toe control curve
curve_10 = Curve(<curve referenced from the Rhino model>)
surface_4 = Surface(<surface referenced from the Rhino model>)
length_10 = Length(Curve=curve_10)
panel_10 = Panel(length_10)
control_points_19 = ControlPoints(Curve=curve_10)  # -> Points, Weights, Knots
mesh_closest_point_10 = MeshClosestPoint(Point=control_points_19.Points, Mesh=triangulate.Mesh)  # -> Point, Index, Parameter
division_19 = Division(A=length_10, B=toe_box)
area_10 = Area(Geometry=curve_10)  # -> Area, Centroid
division_20 = Division(A=1, B=division_19)
scale_10 = Scale(Geometry=curve_10, Center=area_10.Centroid, Factor=division_20)  # -> Geometry, Transform
mesh_eval_10 = MeshEval(Mesh=triangulate.Mesh, Parameter=mesh_closest_point_10.Parameter)  # -> Point, Normal, Colour
control_points_20 = ControlPoints(Curve=scale_10.Geometry)  # -> Points, Weights, Knots
vector_2pt_10 = Vector2Pt(PointA=mesh_closest_point_10.Point, PointB=control_points_20.Points, Unitize=False)  # -> Vector, Length
spatial_deform_custom_10 = SpatialDeformCustom(Geometry=triangulate.Mesh, Syntax=mesh_eval_10.Point, Forces=vector_2pt_10.Vector, Falloff="1/x^3")  # disabled
colour_picker_10 = ColourPicker(PickedColour=RGB(187, 209, 63))
vector_display_ex_10 = VectorDisplayEx(Point=mesh_closest_point_10.Point, Vector=vector_2pt_10.Vector, Colour=colour_picker_10, Width=Slider(3, range=0..100))

# ----
# Ball control curve
surface_5 = Surface(<surface referenced from the Rhino model>)
curve_11 = Curve(<curve referenced from the Rhino model>)
length_11 = Length(Curve=curve_11)
panel_11 = Panel(length_11)
control_points_21 = ControlPoints(Curve=curve_11)  # -> Points, Weights, Knots
mesh_closest_point_11 = MeshClosestPoint(Point=control_points_21.Points, Mesh=triangulate_2.Mesh)  # -> Point, Index, Parameter
division_21 = Division(A=length_11, B=ball_2)
area_11 = Area(Geometry=surface_5)  # -> Area, Centroid
division_22 = Division(A=1, B=division_21)
mesh_eval_11 = MeshEval(Mesh=triangulate_2.Mesh, Parameter=mesh_closest_point_11.Parameter)  # -> Point, Normal, Colour
scale_11 = Scale(Geometry=curve_11, Center=area_11.Centroid, Factor=division_22)  # -> Geometry, Transform
control_points_22 = ControlPoints(Curve=scale_11.Geometry)  # -> Points, Weights, Knots
vector_2pt_11 = Vector2Pt(PointA=mesh_closest_point_11.Point, PointB=control_points_22.Points, Unitize=False)  # -> Vector, Length
spatial_deform_custom_11 = SpatialDeformCustom(Geometry=triangulate_2.Mesh, Syntax=mesh_eval_11.Point, Forces=vector_2pt_11.Vector, Falloff="1/x^3")  # disabled
colour_picker_11 = ColourPicker(PickedColour=RGB(187, 209, 63))
vector_display_ex_11 = VectorDisplayEx(Point=mesh_closest_point_11.Point, Vector=vector_2pt_11.Vector, Colour=colour_picker_11, Width=Slider(3, range=0..100))

# ----
# Sole
# control curve
curve_12 = Curve(<curve referenced from the Rhino model>)
surface_6 = Surface(<surface referenced from the Rhino model>)
length_12 = Length(Curve=curve_12)
panel_12 = Panel(length_12)
control_points_23 = ControlPoints(Curve=curve_12)  # -> Points, Weights, Knots
mesh_closest_point_12 = MeshClosestPoint(Point=control_points_23.Points, Mesh=triangulate_3.Mesh)  # -> Point, Index, Parameter
division_23 = Division(A=length_12, B=sole_3)
area_12 = Area(Geometry=surface_6)  # -> Area, Centroid
division_24 = Division(A=1, B=division_23)
mesh_eval_12 = MeshEval(Mesh=triangulate_3.Mesh, Parameter=mesh_closest_point_12.Parameter)  # -> Point, Normal, Colour
scale_12 = Scale(Geometry=curve_12, Center=area_12.Centroid, Factor=division_24)  # -> Geometry, Transform
control_points_24 = ControlPoints(Curve=scale_12.Geometry)  # -> Points, Weights, Knots
vector_2pt_12 = Vector2Pt(PointA=mesh_closest_point_12.Point, PointB=control_points_24.Points, Unitize=False)  # -> Vector, Length
spatial_deform_custom_12 = SpatialDeformCustom(Geometry=triangulate_3.Mesh, Syntax=mesh_eval_12.Point, Forces=vector_2pt_12.Vector, Falloff="1/x^3")  # disabled
colour_picker_12 = ColourPicker(PickedColour=RGB(115, 125, 60))
vector_display_ex_12 = VectorDisplayEx(Point=mesh_closest_point_12.Point, Vector=vector_2pt_12.Vector, Colour=colour_picker_12, Width=Slider(3, range=0..100))

# ----
# Ankle control curve
curve_13 = Curve(<curve referenced from the Rhino model>)
length_13 = Length(Curve=curve_13)
panel_13 = Panel(length_13)
control_points_25 = ControlPoints(Curve=curve_13)  # -> Points, Weights, Knots
mesh_closest_point_13 = MeshClosestPoint(Point=control_points_25.Points, Mesh=triangulate_3.Mesh)  # -> Point, Index, Parameter
division_25 = Division(A=length_13, B=ankle_3)
area_13 = Area(Geometry=curve_13)  # -> Area, Centroid
division_26 = Division(A=1, B=division_25)
mesh_eval_13 = MeshEval(Mesh=triangulate_3.Mesh, Parameter=mesh_closest_point_13.Parameter)  # -> Point, Normal, Colour
scale_13 = Scale(Geometry=curve_13, Center=area_13.Centroid, Factor=division_26)  # -> Geometry, Transform
control_points_26 = ControlPoints(Curve=scale_13.Geometry)  # -> Points, Weights, Knots
vector_2pt_13 = Vector2Pt(PointA=mesh_closest_point_13.Point, PointB=control_points_26.Points, Unitize=False)  # -> Vector, Length
spatial_deform_custom_13 = SpatialDeformCustom(Geometry=triangulate_3.Mesh, Syntax=mesh_eval_13.Point, Forces=vector_2pt_13.Vector, Falloff="1/x^3")  # disabled
colour_picker_13 = ColourPicker(PickedColour=RGB(187, 209, 63))
vector_display_ex_13 = VectorDisplayEx(Point=mesh_closest_point_13.Point, Vector=vector_2pt_13.Vector, Colour=colour_picker_13, Width=Slider(3, range=0..100))

# ----
# Instep control curve
curve_14 = Curve(<curve referenced from the Rhino model>)
length_14 = Length(Curve=curve_14)
panel_14 = Panel(length_14)
control_points_27 = ControlPoints(Curve=curve_14)  # -> Points, Weights, Knots
mesh_closest_point_14 = MeshClosestPoint(Point=control_points_27.Points, Mesh=triangulate_3.Mesh)  # -> Point, Index, Parameter
division_27 = Division(A=length_14, B=instep_3)
area_14 = Area(Geometry=curve_14)  # -> Area, Centroid
division_28 = Division(A=1, B=division_27)
mesh_eval_14 = MeshEval(Mesh=triangulate_3.Mesh, Parameter=mesh_closest_point_14.Parameter)  # -> Point, Normal, Colour
scale_14 = Scale(Geometry=curve_14, Center=area_14.Centroid, Factor=division_28)  # -> Geometry, Transform
control_points_28 = ControlPoints(Curve=scale_14.Geometry)  # -> Points, Weights, Knots
vector_2pt_14 = Vector2Pt(PointA=mesh_closest_point_14.Point, PointB=control_points_28.Points, Unitize=False)  # -> Vector, Length
spatial_deform_custom_14 = SpatialDeformCustom(Geometry=triangulate_3.Mesh, Syntax=mesh_eval_14.Point, Forces=vector_2pt_14.Vector, Falloff="1/x^3")  # disabled
colour_picker_14 = ColourPicker(PickedColour=RGB(193, 209, 102))
vector_display_ex_14 = VectorDisplayEx(Point=mesh_closest_point_14.Point, Vector=vector_2pt_14.Vector, Colour=colour_picker_14, Width=Slider(3, range=0..100))

# ----
# Waist control curve
curve_15 = Curve(<curve referenced from the Rhino model>)
length_15 = Length(Curve=curve_15)
panel_15 = Panel(length_15)
control_points_29 = ControlPoints(Curve=curve_15)  # -> Points, Weights, Knots
mesh_closest_point_15 = MeshClosestPoint(Point=control_points_29.Points, Mesh=triangulate_3.Mesh)  # -> Point, Index, Parameter
division_29 = Division(A=length_15, B=waist_3)
area_15 = Area(Geometry=curve_15)  # -> Area, Centroid
division_30 = Division(A=1, B=division_29)
mesh_eval_15 = MeshEval(Mesh=triangulate_3.Mesh, Parameter=mesh_closest_point_15.Parameter)  # -> Point, Normal, Colour
scale_15 = Scale(Geometry=curve_15, Center=area_15.Centroid, Factor=division_30)  # -> Geometry, Transform
control_points_30 = ControlPoints(Curve=scale_15.Geometry)  # -> Points, Weights, Knots
vector_2pt_15 = Vector2Pt(PointA=mesh_closest_point_15.Point, PointB=control_points_30.Points, Unitize=False)  # -> Vector, Length
spatial_deform_custom_15 = SpatialDeformCustom(Geometry=triangulate_3.Mesh, Syntax=mesh_eval_15.Point, Forces=vector_2pt_15.Vector, Falloff="1/x^3")  # disabled
colour_picker_15 = ColourPicker(PickedColour=RGB(56, 59, 39))
vector_display_ex_15 = VectorDisplayEx(Point=mesh_closest_point_15.Point, Vector=vector_2pt_15.Vector, Colour=colour_picker_15, Width=Slider(3, range=0..100))

# ----
# Ball control curve
surface_7 = Surface(<surface referenced from the Rhino model>)
curve_16 = Curve(<curve referenced from the Rhino model>)
length_16 = Length(Curve=curve_16)
panel_16 = Panel(length_16)
control_points_31 = ControlPoints(Curve=curve_16)  # -> Points, Weights, Knots
mesh_closest_point_16 = MeshClosestPoint(Point=control_points_31.Points, Mesh=triangulate_3.Mesh)  # -> Point, Index, Parameter
division_31 = Division(A=length_16, B=ball_3)
area_16 = Area(Geometry=surface_7)  # -> Area, Centroid
division_32 = Division(A=1, B=division_31)
mesh_eval_16 = MeshEval(Mesh=triangulate_3.Mesh, Parameter=mesh_closest_point_16.Parameter)  # -> Point, Normal, Colour
scale_16 = Scale(Geometry=curve_16, Center=area_16.Centroid, Factor=division_32)  # -> Geometry, Transform
control_points_32 = ControlPoints(Curve=scale_16.Geometry)  # -> Points, Weights, Knots
vector_2pt_16 = Vector2Pt(PointA=mesh_closest_point_16.Point, PointB=control_points_32.Points, Unitize=False)  # -> Vector, Length
spatial_deform_custom_16 = SpatialDeformCustom(Geometry=triangulate_3.Mesh, Syntax=mesh_eval_16.Point, Forces=vector_2pt_16.Vector, Falloff="1/x^3")  # disabled
colour_picker_16 = ColourPicker(PickedColour=RGB(187, 209, 63))
vector_display_ex_16 = VectorDisplayEx(Point=mesh_closest_point_16.Point, Vector=vector_2pt_16.Vector, Colour=colour_picker_16, Width=Slider(3, range=0..100))

# ----
# Output
# Enable when ready.
# It takes around 40 seconds
# to compute a result.
merge = Merge(
    Data1=mesh_eval_10.Point,
    Data2=mesh_eval_8.Point,
    Data3=mesh_eval_6.Point,
    Data4=mesh_eval_4.Point,
    Data5=mesh_eval_2.Point,
    Data6=mesh_eval.Point)
merge_2 = Merge(
    Data1=vector_2pt_10.Vector,
    Data2=vector_2pt_8.Vector,
    Data3=vector_2pt_6.Vector,
    Data4=vector_2pt_4.Vector,
    Data5=vector_2pt_2.Vector,
    Data6=vector_2pt.Vector)
colour_picker_17 = ColourPicker(PickedColour=RGB(34, 142, 178))
spatial_deform_custom_17 = SpatialDeformCustom(Geometry=triangulate.Mesh, Syntax=merge, Forces=merge_2, Falloff="1/x^3")  # disabled
vector_display_ex_17 = VectorDisplayEx(Point=merge, Vector=merge_2, Colour=colour_picker_17, Width=Slider(3, range=0..100))

# ----
# Output
# Enable when ready.
# It takes around 40 seconds
# to compute a result.
merge_3 = Merge(
    Data2=mesh_eval_11.Point,
    Data3=mesh_eval_9.Point,
    Data4=mesh_eval_7.Point,
    Data5=mesh_eval_5.Point,
    Data6=mesh_eval_3.Point)
merge_4 = Merge(
    Data2=vector_2pt_11.Vector,
    Data3=vector_2pt_9.Vector,
    Data4=vector_2pt_7.Vector,
    Data5=vector_2pt_5.Vector,
    Data6=vector_2pt_3.Vector)
colour_picker_18 = ColourPicker(PickedColour=RGB(34, 142, 178))
spatial_deform_custom_18 = SpatialDeformCustom(Geometry=triangulate_2.Mesh, Syntax=merge_3, Forces=merge_4, Falloff="1/x^3")
vector_display_ex_18 = VectorDisplayEx(Point=merge_3, Vector=merge_4, Colour=colour_picker_18, Width=Slider(3, range=0..100))

# ----
# Outer curve
points_curve = Slider(479, range=0..500)
# Last
brep_4 = Brep(<brep referenced from the Rhino model>)
curve_17 = Curve(<curve referenced from the Rhino model>)
# Vamp
curve_18 = Curve(<curve referenced from the Rhino model>)
# Inner curve
curve_19 = Curve(<curve referenced from the Rhino model>)
divide_curve = DivideCurve(Curve=curve_17, Count=points_curve, Kinks=False)  # -> Points, Tangents, Parameters
divide_curve_2 = DivideCurve(Curve=curve_19, Count=points_curve, Kinks=False)  # -> Points, Tangents, Parameters
divide_curve_3 = DivideCurve(Curve=curve_18, Count=points_curve, Kinks=False)  # -> Points, Tangents, Parameters
distance = Slider(3, range=-10..10)
distance_2 = Slider(-3, range=-10..10)
brep_closest_point = BrepClosestPoint(Point=divide_curve.Points, Brep=brep_4)  # -> Point, Normal, Distance
brep_closest_point_2 = BrepClosestPoint(Point=divide_curve_2.Points, Brep=brep_4)  # -> Point, Normal, Distance
brep_closest_point_3 = BrepClosestPoint(Point=divide_curve_3.Points, Brep=brep_4)  # -> Point, Normal, Distance
multiplication = Multiplication(A=brep_closest_point.Normal, B=distance_2)
multiplication_2 = Multiplication(A=brep_closest_point.Normal, B=distance)
boolean_toggle = BooleanToggle(True)
move = Move(Geometry=brep_closest_point.Point, Motion=multiplication)  # -> Geometry, Transform
move_2 = Move(Geometry=brep_closest_point.Point, Motion=multiplication_2)  # -> Geometry, Transform
polyline = PolyLine(Vertices=move_2.Geometry, Closed=boolean_toggle)
polyline_2 = PolyLine(Vertices=move.Geometry, Closed=boolean_toggle)
line = Line(StartPoint=move.Geometry, EndPoint=move_2.Geometry)
sweep2 = Sweep2(Rail1=polyline_2, Rail2=polyline, Sections=line, SameHeight=False)
brep_selection = Slider(0, range=0..1)
split_brep = SplitBrep(Brep=brep_4, Cutter=sweep2)
list_item = ListItem(List=split_brep, Index=brep_selection, Wrap=True)
deconstruct_brep = DeconstructBrep(Brep=list_item)  # -> Faces, Edges, Vertices
surface_selection = Slider(0, range=0..1)

# ----
# Upper out
brep_5 = Brep(<brep referenced from the Rhino model>)
surface_selection_2 = Slider(15, range=0..20)
deconstruct_brep_2 = DeconstructBrep(Brep=brep_5)  # -> Faces, Edges, Vertices
list_item_2 = ListItem(List=deconstruct_brep_2.Faces, Index=surface_selection_2, Wrap=True)
area_17 = Area(Geometry=list_item_2)  # -> Area, Centroid
panel_17 = Panel(area_17.Area)

list_item_3 = ListItem(List=deconstruct_brep.Faces, Index=surface_selection, Wrap=True)
curve_selection = Slider(1, range=0..5)
curve_selection_2 = Slider(0, range=0..5)
deconstruct_brep_3 = DeconstructBrep(Brep=list_item_3)  # -> Faces, Edges, Vertices
curve_selection_3 = Slider(2, range=0..5)
curve_selection_4 = Slider(3, range=0..5)
join_curves = JoinCurves(Curves=deconstruct_brep_3.Edges, Preserve=False)
list_item_4 = ListItem(List=deconstruct_brep_3.Edges, Index=curve_selection, Wrap=True)
list_item_5 = ListItem(List=deconstruct_brep_3.Edges, Index=curve_selection_4, Wrap=True)
list_item_6 = ListItem(List=deconstruct_brep_3.Edges, Index=curve_selection_3, Wrap=True)
list_item_7 = ListItem(List=deconstruct_brep_3.Edges, Index=curve_selection_2, Wrap=True)
merge_5 = Merge(Data1=list_item_5, Data2=list_item_7)
length_17 = Length(Curve=list_item_4)
panel_18 = Panel(length_17)
length_18 = Length(Curve=list_item_6)
panel_19 = Panel(length_18)
join_curves_2 = JoinCurves(Curves=merge_5, Preserve=False)
length_19 = Length(Curve=join_curves_2)
panel_20 = Panel(length_19)
explode = Explode(Curve=list_item_4, Recursive=True)  # -> Segments, Vertices
area_18 = Area(Geometry=deconstruct_brep_3.Faces)  # -> Area, Centroid
panel_21 = Panel(area_18.Area)
divide_curve_4 = DivideCurve(Curve=join_curves_2, Count=Slider(60, range=0..100), Kinks=False)  # -> Points, Tangents, Parameters
divide_curve_5 = DivideCurve(Curve=list_item_6, Count=Slider(60, range=0..100), Kinks=False)  # -> Points, Tangents, Parameters
dimensions = Dimensions(Surface=deconstruct_brep_3.Faces)  # -> UDimension, VDimension
xz_plane = XZPlane(Origin=area_18.Centroid)
merge_6 = Merge(Data1=explode.Vertices, Data2=divide_curve_5.Points, Data3=divide_curve_4.Points)  # -> flatten(Result)
line_2 = Line(StartPoint=area_18.Centroid, EndPoint=merge_6)
plane_surface = PlaneSurface(Plane=xz_plane, XSize=dimensions.VDimension, YSize=dimensions.UDimension)
unit_y = UnitY(Factor=1)
area_19 = Area(Geometry=plane_surface)  # -> Area, Centroid
project = Project(Curve=line_2, Brep=deconstruct_brep_3.Faces, Direction=unit_y)  # -> flatten(Curve)
vector_2pt_17 = Vector2Pt(PointA=area_19.Centroid, PointB=area_18.Centroid, Unitize=False)  # -> Vector, Length
length_20 = Length(Curve=project)
move_3 = Move(Geometry=plane_surface, Motion=vector_2pt_17.Vector)  # -> Geometry, Transform
project_2 = Project(Curve=line_2, Brep=move_3.Geometry, Direction=unit_y)  # -> flatten(Curve)
explode_2 = Explode(Curve=project_2, Recursive=True)  # -> Segments, flatten(Vertices)
removeduplicatepts = RemoveDuplicatePts(Points=explode_2.Vertices, Tolerance=0.01)
list_length = ListLength(List=removeduplicatepts)
subtraction = Subtraction(A=list_length, B=1)
construct_domain = ConstructDomain(DomainStart=Slider(1, range=0..784), DomainEnd=subtraction)
sub_list = SubList(List=removeduplicatepts, Domain=construct_domain, Wrap=True)  # -> List, Index
polyline_3 = PolyLine(Vertices=sub_list.List, Closed=Toggle(True))
boundary_surfaces = BoundarySurfaces(Edges=polyline_3)
area_20 = Area(Geometry=boundary_surfaces)  # -> Area, Centroid
deconstruct = Deconstruct(Point=area_20.Centroid)  # -> XComponent, YComponent, ZComponent
distance_3 = Slider(281.769, range=-500..500)
addition = Addition(A=deconstruct.XComponent, B=distance_3)
construct_point = ConstructPoint(XCoordinate=addition, YCoordinate=deconstruct.YComponent, ZCoordinate=deconstruct.ZComponent)
vector_2pt_18 = Vector2Pt(PointA=area_20.Centroid, PointB=construct_point, Unitize=False)  # -> Vector, Length
move_4 = Move(Geometry=boundary_surfaces, Motion=vector_2pt_18.Vector)  # -> Geometry, Transform

# ----
# Output
# Enable when ready.
# It takes around 40 seconds
# to compute a result.
merge_7 = Merge(Data2=mesh_eval_16.Point, Data3=mesh_eval_15.Point, Data4=mesh_eval_14.Point, Data5=mesh_eval_13.Point)
merge_8 = Merge(Data2=vector_2pt_16.Vector, Data3=vector_2pt_15.Vector, Data4=vector_2pt_14.Vector, Data5=vector_2pt_13.Vector)
colour_picker_19 = ColourPicker(PickedColour=RGB(34, 142, 178))
vector_display_ex_19 = VectorDisplayEx(Point=merge_7, Vector=merge_8, Colour=colour_picker_19, Width=Slider(3, range=0..100))

spatial_deform_custom_19 = SpatialDeformCustom(Geometry=triangulate_3.Mesh, Syntax=mesh_eval_12.Point, Forces=vector_2pt_12.Vector, Falloff="1/x^3")  # disabled

spatial_deform_custom_20 = SpatialDeformCustom(Geometry=spatial_deform_custom_19, Syntax=merge_7, Forces=merge_8, Falloff="1/x^3")  # disabled
